# Grasshopper definition Scout Demo_CompDesign.ghx (Grasshopper 1.0.7)
# plug-ins: Triceratops

# ----
# Inputs
inputs_panel = Panel("")
# XIM Standards
# Notes: Panels can (but do not have to) be 50% saturation to avoid overwhelming in text
data = Data(True)

# ----
# Ouputs
data_2 = Data(True)
# COMPUTATIONAL MODEL
# 1. create computational model
result_panel = Panel("")

# ----
# GLOBALS for SCOUT
input_names_list = Panel("""resolution
location of explosion
strength_of_explosion""")
output_names_list = Panel("""volume
distance
angle""")

series = Series(Start="1", Step=1, Count="5")

# ---- group: connect all input lists / actual input values
series_2 = Series(Start="5", Step=1, Count="8")

# ----
# Intermediate
data_3 = Data(True)

# ----
# Note
note_panel = Panel("")

# ----
# 2. declare all inputs and outputs
txt_input_names_list = Text(flatten(input_names_list))
txt_output_names_list = Text(flatten(output_names_list))
case = TextCase(Text=txt_input_names_list, Culture=127)  # -> UpperCase, LowerCase
case_2 = TextCase(Text=txt_output_names_list, Culture=127)  # -> UpperCase, LowerCase
rep = ReplaceText(Text=case.LowerCase, Find=" ", Replace="_", RecursiveReplace=False)
rep_2 = ReplaceText(Text=case_2.LowerCase, Find=" ", Replace="_", RecursiveReplace=False)
txt_output_names = Text(rep)
txt_output_names_2 = Text(rep_2)

input_index = Panel("1")
inputs_panel_2 = Panel("""0
1
2
3
4""")
item = ListItem(List=txt_output_names, Index=input_index, Wrap=True)
int_location = Integer(inputs_panel_2)
input_name = Panel(item)
label = Panel("location of explosion")
ticks = Panel(int_location)
cluster_input_settings = ClusterInputSettings(txt_input_title=item, txt_label=label, _0=ticks)

# ----
# Groups
# Previews
# Actions
panel = Panel("don't change")

# ---- group: connect all input lists
label_2 = Panel("subdivision resolution")
ticks_2 = Panel("""tiny
small
small-ish
mid
chunks
large-ish
large
huge""")

input_index_2 = Panel("0")
# EXPORT TO SCOUT
item_2 = ListItem(List=txt_output_names, Index=input_index_2, Wrap=True)
input_name_2 = Panel(item_2)
cluster_input_settings_2 = ClusterInputSettings(txt_input_title=item_2, txt_label=label_2, _0=ticks_2)
int_resolution = Integer(series_2)

# ----
label_3 = Panel("title in scout")
ticks_3 = Panel("""tick0
tick1
tick2
...""")

# ----
# computational model
input_index_3 = Panel("x")
item_3 = ListItem(List=txt_output_names, Index=input_index_3, Wrap=True)
int_strength = Integer()
input_name_3 = Panel(item_3)
cluster_input_settings_3 = ClusterInputSettings(txt_input_title=item_3, txt_label=label_3, _0=ticks_3)

# ----
# 7.0 clear your folders
# before re-running all outputs
button = Button()

# ----
# Context Geometry
brep_context = Brep(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)
debrep = DeconstructBrep(Brep=brep_context)  # -> Faces, Edges, Vertices
item_4 = ListItem(List=debrep.Faces, Index=4, Wrap=True)
xy = XYPlane(Origin=Point(0, 0, 0))
Z = UnitZ(Factor="-35")
move = Move(Geometry=xy, Motion=Z)  # -> Geometry, Transform
project = Project(Geometry=item_4, Plane=move.Geometry)  # -> Geometry, Transform

txt_output_names_3 = Text(txt_output_names_2)

# ---- group: one colored mesh for context
# Create Other meshes with different Color
metalness = Slider(0.5, range=0..1)
opacity = Slider(1, range=0..1)
roughness = Slider(1, range=0..1)
data_metalness = Data(metalness)
data_roughness = Data(roughness)
data_opacity = Data(opacity)
standardmat = MeshStandardMaterial(
    Color=ColourSwatch(SwatchColor=RGB(255, 255, 255)),
    Opacity=data_opacity,
    Roughness=data_roughness,
    Metalness=data_metalness,
    Emissive=RGB(0, 0, 0),
    EmissiveIntensity=1)

metalness_2 = Slider(0.5, range=0..1)
opacity_2 = Slider(1, range=0..1)
roughness_2 = Slider(1, range=0..1)
data_metalness_2 = Data(metalness_2)
data_roughness_2 = Data(roughness_2)
data_opacity_2 = Data(opacity_2)
standardmat_2 = MeshStandardMaterial(
    Color=ColourSwatch(SwatchColor=RGB(255, 255, 255)),
    Opacity=data_opacity_2,
    Roughness=data_roughness_2,
    Metalness=data_metalness_2,
    Emissive=RGB(0, 0, 0),
    EmissiveIntensity=1)

geo = Geometry()
mesh = MeshBrep(
    Brep=geo,
    Settings={GridMaxCount=0, GridMinCount=16, JaggedSeams=False, MaxEdgeLength=0, MinEdgeLength=0.0001, MinTolerance=0, Refine=True, RefineAngle=0, RelativeTolerance=0.65, SimplePlanes=True, Tolerance=0})
tri = Triangulate(Mesh=mesh)  # -> Mesh, Count
mjoin = MeshJoin(Meshes=tri.Mesh)
mesh_2 = Mesh(Mesh=mjoin, Material=standardmat, DecimalAccuracy=3)

geo_2 = Geometry(flatten(project.Geometry))
mesh_3 = MeshBrep(
    Brep=geo_2,
    Settings={GridMaxCount=0, GridMinCount=16, JaggedSeams=False, MaxEdgeLength=0, MinEdgeLength=0.0001, MinTolerance=0, Refine=True, RefineAngle=0, RelativeTolerance=0.65, SimplePlanes=True, Tolerance=0})
tri_2 = Triangulate(Mesh=mesh_3)  # -> Mesh, Count
mjoin_2 = MeshJoin(Meshes=tri_2.Mesh)
mesh_4 = Mesh(Mesh=mjoin_2, Material=standardmat_2, DecimalAccuracy=3)

# ----
input_index_4 = Panel("2")
item_5 = ListItem(List=txt_output_names, Index=input_index_4, Wrap=True)
int_strength_2 = Integer(series)
input_name_4 = Panel(item_5)

label_4 = Panel("strength of explosion")
ticks_4 = Panel(int_strength_2)

cluster_input_settings_4 = ClusterInputSettings(txt_input_title=item_5, txt_label=label_4, _0=ticks_4)

# ---- group: connect all settings for input
merge = Merge(Data1=cluster_input_settings_2, Data2=cluster_input_settings, Data3=cluster_input_settings_4)

# ---- group: input set
int_location_2 = Integer(int_location)
lng = ListLength(List=int_location_2)
series_3 = Series(Start=0, Step=1, Count=lng)

int_strength_3 = Integer(int_strength_2)
lng_2 = ListLength(List=int_strength_3)
series_4 = Series(Start=0, Step=1, Count=lng_2)

int_strength_4 = Integer(int_strength)
lng_3 = ListLength(List=int_strength_4)
series_5 = Series(Start=0, Step=1, Count=lng_3)

# ---- group: connect all input lists / input set
int_resolution_2 = Integer(int_resolution)
lng_4 = ListLength(List=int_resolution_2)
series_6 = Series(Start=0, Step=1, Count=lng_4)

# ----
# 3. set all inputs
# make sure:
#  # of input = # of ticks
crossref = CrossReference(ListA=series_6, ListB=series_3, ListC=series_4, CrossMode=1)  # -> ListA, ListB, ListC, ListD

# ----
# Note: upper limit of slider = # of options -1
# animation frame = # of options +1
# 7.1. animate all options
lng_5 = ListLength(List=crossref.ListA)
number_of_options = Panel(lng_5)
int_iteration_index = Integer(Slider(199, range=0..199))

# ---- group: input set (continued)
item_6 = ListItem(List=crossref.ListC, Index=int_iteration_index, Wrap=True)
item_7 = ListItem(List=int_strength_3, Index=item_6, Wrap=True)
int_strength_index = Integer(flatten(item_6))
int_strength_5 = Integer(item_7)

item_8 = ListItem(List=crossref.ListB, Index=int_iteration_index, Wrap=True)
item_9 = ListItem(List=int_location_2, Index=item_8, Wrap=True)
int_location_index = Integer(flatten(item_8))
int_location_3 = Integer(item_9)

item_10 = ListItem(Index=int_iteration_index, Wrap=True)
item_11 = ListItem(List=int_strength_4, Index=item_10, Wrap=True)
int_strength_index_2 = Integer(flatten(item_10))
# computational model
int_strength_6 = Integer(item_11)

# ---- group: connect all input lists / input set (continued)
item_12 = ListItem(List=crossref.ListA, Index=int_iteration_index, Wrap=True)
item_13 = ListItem(List=int_resolution_2, Index=item_12, Wrap=True)
int_resolution_index = Integer(flatten(item_12))
int_resolution_3 = Integer(item_13)

# ----
# Computational Design Model
cluster = Cluster(int_resolution_of_grid=int_resolution_3, int_explosion_location=int_location_3, int_explosion_strength=int_strength_5)  # -> geo_shapes_2, geometry_6, geo_shapes_to_color_2, int_volume_total_2, int_volume_shape_2, geometry_5, num_distance_shape_3, num_distance_average_3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

# ----
# Actions if
# changed set up
# DO NOT CHANGE
wires = BrepWireframe(Brep=cluster.geo_shapes_2, Density=-1)
number_of_unique_face_angles = Panel(cluster.num_angle_number_of_unique_2)
total_volume = Panel(cluster.int_volume_total_2)
avg_movement = Panel(cluster.num_distance_average_3)

# ---- group: connect all index of inputs
int_resolution_index_2 = Integer(flatten(int_resolution_index))
int_location_index_2 = Integer(flatten(int_location_index))
int_strength_iindex = Integer(flatten(int_strength_index))
merge_all_inputs = Merge(Data1=int_resolution_index_2, Data2=int_location_index_2, Data3=int_strength_iindex)

# ----
preview = CustomPreview(Geometry=wires, Material=ColourSwatch(SwatchColor=RGB(0, 0, 0)))

# ----
# Write data.csv and settings.json when you are ready!
# 8. write final files
button_2 = Button()
equals = Equality(FirstNumber=int_iteration_index, SecondNumber=expr("x-1", number_of_options))  # -> Equality, Inequality
or = GateOr(A=button_2)

num_average_movement = Number(flatten(cluster.num_distance_average_3))
num_angle_number_of_unique = Number(flatten(cluster.num_angle_number_of_unique_2))
num_total_volume = Number(flatten(cluster.int_volume_total_2))
geo_shapes_to_color = Geometry(cluster.geo_shapes_to_color_2)
int_volume_shape = Number(cluster.int_volume_shape_2)
geo_shapes_to_color_2 = Geometry(cluster.geo_shapes_to_color_2)
num_distance_shape = Number(cluster.num_distance_shape_3)
geo_shapes_to_color_3 = Geometry(cluster.geo_faces_2)
num_angle_face = Number(cluster.num_angle_face_2)
data_iteration = Data(int_iteration_index)
geo_base_shapes = Geometry(cluster.geo_shapes_2)

# ---- group: construct file path
# file paths
nickname = RelativePath()
c_create_directory = CSharpScript(topLevel=nickname, folderName="\scout_upload", x=int_iteration_index)  # -> out, filePath; inputs topLevel: String, folderName: String
# ---------- c_create_directory: C# ----------
    string path = topLevel + folderName;
    System.IO.Directory.CreateDirectory(path);
    filePath = path;
# ---------- end c_create_directory ----------
c_create_directory_2 = CSharpScript(topLevel=c_create_directory.filePath, folderName="\models")  # -> out, filePath; inputs topLevel: String, folderName: String; same code as c_create_directory
c_create_directory_3 = CSharpScript(topLevel=c_create_directory.filePath, folderName="\.temp")  # -> out, filePath; inputs topLevel: String, folderName: String; same code as c_create_directory

# ----
c_script = CSharpScript(directory=[c_create_directory_2.filePath, c_create_directory_3.filePath], clear=button)  # -> out, A; inputs directory: String, clear: Boolean
# ---------- c_script: C# usings ----------
using System.IO;
# ---------- c_script: C# ----------
    if (clear){
      System.IO.DirectoryInfo di = new DirectoryInfo(directory);

      foreach (FileInfo file in di.GetFiles())
      {
        file.Delete();
      }
      foreach (DirectoryInfo dir in di.GetDirectories())
      {
        dir.Delete(true);
      }
      A = true;
    }
# ---------- end c_script ----------

# ---- group: construct final data.csv from .temp folder
cluster_2 = Cluster_4(p_file_path=c_create_directory.filePath, directory=c_create_directory_3.filePath, bool=or)  # -> P, warning_2

# ----
panel_2 = Panel(c_script.A)
filter = StreamFilter(Gate=or, Stream1=c_create_directory.filePath)

num_values_to_color_mesh_by = Number()
geo_3 = Geometry()
some_output = Panel("xxxx")
output_index = Panel("x")
mesh_5 = MeshBrep(
    Brep=geo_3,
    Settings={GridMaxCount=0, GridMinCount=16, JaggedSeams=False, MaxEdgeLength=0, MinEdgeLength=0.0001, MinTolerance=0, Refine=True, RefineAngle=0, RelativeTolerance=0.65, SimplePlanes=True, Tolerance=0})
item_14 = ListItem(List=txt_output_names_3, Index=output_index, Wrap=True)
output_name = Panel(item_14)
cluster_output_analysis_mesh = ClusterOutputAnalysisMesh(
    txt_file_path=c_create_directory_2.filePath,
    int_index=data_iteration,
    txt_output_name=item_14,
    m_exploded_analysis_mesh=mesh_5,
    V=num_values_to_color_mesh_by)  # disabled
panel_3 = Panel(cluster_output_analysis_mesh)
bnd = Bounds(Numbers=num_values_to_color_mesh_by)
data_bounds = Panel(bnd)

num_values_to_color_mesh_by_2 = Number(flatten(num_angle_face))
geo_4 = Geometry(flatten(geo_shapes_to_color_3))
number_of_unique_face_angles_2 = Panel(num_angle_number_of_unique)
output_index_2 = Panel("2")
mesh_6 = MeshBrep(
    Brep=geo_4,
    Settings={GridMaxCount=0, GridMinCount=16, JaggedSeams=False, MaxEdgeLength=0, MinEdgeLength=0.0001, MinTolerance=0, Refine=True, RefineAngle=0, RelativeTolerance=0.65, SimplePlanes=True, Tolerance=0})
item_15 = ListItem(List=txt_output_names_3, Index=output_index_2, Wrap=True)
output_name_2 = Panel(item_15)
cluster_output_analysis_mesh_2 = ClusterOutputAnalysisMesh(
    txt_file_path=c_create_directory_2.filePath,
    int_index=data_iteration,
    txt_output_name=item_15,
    m_exploded_analysis_mesh=mesh_6,
    V=num_values_to_color_mesh_by_2)
panel_4 = Panel(cluster_output_analysis_mesh_2)
bnd_2 = Bounds(Numbers=num_values_to_color_mesh_by_2)
data_bounds_2 = Panel(bnd_2)

geo_5 = Geometry(flatten(geo_shapes_to_color_2))
output_index_3 = Panel("1")
avg_movement_2 = Panel(num_average_movement)
num_values_to_color_mesh_by_3 = Number(flatten(num_distance_shape))
mesh_7 = MeshBrep(
    Brep=geo_5,
    Settings={GridMaxCount=0, GridMinCount=16, JaggedSeams=False, MaxEdgeLength=0, MinEdgeLength=0.0001, MinTolerance=0, Refine=True, RefineAngle=0, RelativeTolerance=0.65, SimplePlanes=True, Tolerance=0})
item_16 = ListItem(List=txt_output_names_3, Index=output_index_3, Wrap=True)
output_name_3 = Panel(item_16)
cluster_output_analysis_mesh_3 = ClusterOutputAnalysisMesh(
    txt_file_path=c_create_directory_2.filePath,
    int_index=data_iteration,
    txt_output_name=item_16,
    m_exploded_analysis_mesh=mesh_7,
    V=num_values_to_color_mesh_by_3)
panel_5 = Panel(cluster_output_analysis_mesh_3)
bnd_3 = Bounds(Numbers=num_values_to_color_mesh_by_3)
data_bounds_3 = Panel(bnd_3)

geo_6 = Geometry(flatten(geo_shapes_to_color))
# 4. configure all analysis output (jsons and settings)
# remember to offset your analysis mesh from your actual geometry
output_index_4 = Panel("0")
total_volume_2 = Panel(num_total_volume)
num_values_to_color_mesh_by_4 = Number(flatten(int_volume_shape))
item_17 = ListItem(List=txt_output_names_3, Index=output_index_4, Wrap=True)
mesh_8 = MeshBrep(
    Brep=geo_6,
    Settings={GridMaxCount=0, GridMinCount=16, JaggedSeams=False, MaxEdgeLength=0, MinEdgeLength=0.0001, MinTolerance=0, Refine=True, RefineAngle=0, RelativeTolerance=0.65, SimplePlanes=True, Tolerance=0})
output_name_4 = Panel(item_17)
cluster_output_analysis_mesh_4 = ClusterOutputAnalysisMesh(
    txt_file_path=c_create_directory_2.filePath,
    int_index=data_iteration,
    txt_output_name=item_17,
    m_exploded_analysis_mesh=mesh_8,
    V=num_values_to_color_mesh_by_4)
panel_6 = Panel(cluster_output_analysis_mesh_4)
bnd_4 = Bounds(Numbers=num_values_to_color_mesh_by_4)
data_bounds_4 = Panel(bnd_4)

# ---- group: connect output single value results in order!
num_total_volume_2 = Number(flatten(total_volume_2))
num_average_movement_2 = Number(flatten(avg_movement_2))
num_angle_number_of_unique_2 = Number(flatten(number_of_unique_face_angles_2))
merge_all_outputs = Merge(Data1=num_total_volume_2, Data2=num_average_movement_2, Data3=num_angle_number_of_unique_2)

# ----
label_5 = Panel("name in scout")
description_text = Panel("text description...")
ticks_5 = Panel("""tick0
tick1
tick2
...""")
min_bound = Panel("0")
unit = Panel("unit")
max_bound = Panel("1")

label_6 = Panel("Avg Movement")
description_text_2 = Panel("distance to center of cube")
ticks_6 = Panel("""0
0.5
1""")
min_bound_2 = Panel("0")
unit_2 = Panel("ft")
max_bound_2 = Panel("1.5")

label_7 = Panel("Number of Unique Face Angles")
description_text_3 = Panel("how much the geometry rotates")
ticks_7 = Panel("""none
lots of rotation""")
min_bound_3 = Panel("0")
unit_3 = Panel("unique angles")
max_bound_3 = Panel("1")

label_8 = Panel("Total Volume")
description_text_4 = Panel("this is colored based on the volumn of each geometry")
min_bound_4 = Panel("0")
unit_4 = Panel("cbft")
ticks_8 = Panel("""100
400
700""")
max_bound_4 = Panel("500")

cluster_3 = Cluster_2(num=num_values_to_color_mesh_by, L=ticks_5, A=min_bound, B=max_bound)

gradient = Gradient(LowerLimit=min_bound, UpperLimit=max_bound, Parameter=cluster_3, stops=[0: RGB(150, 255, 27), 1: RGB(255, 130, 160)])

cluster_output_settings = ClusterOutputSettings(
    txt_output_title=item_14,
    txt_description=description_text,
    T=gradient,
    num_min_bound=min_bound,
    num_max_bound=max_bound,
    txt_label=label_5,
    _0=ticks_5,
    txt_units=unit)
cluster_preview_analysis_mesh = ClusterPreviewAnalysisMesh(T_2=mesh_5, T=gradient)

cluster_4 = Cluster_2(num=num_values_to_color_mesh_by_4, L=ticks_8, A=min_bound_4, B=max_bound_4)

gradient_2 = Gradient(
    LowerLimit=min_bound_4,
    UpperLimit=max_bound_4,
    Parameter=cluster_4,
    stops=[0: RGB(0, 128, 0), 0.501: RGB(60, 186, 217), 1: RGB(255, 255, 0)])

cluster_output_settings_2 = ClusterOutputSettings(
    txt_output_title=item_17,
    txt_description=description_text_4,
    T=gradient_2,
    num_min_bound=min_bound_4,
    num_max_bound=max_bound_4,
    txt_label=label_8,
    _0=ticks_8,
    txt_units=unit_4)
cluster_preview_analysis_mesh_2 = ClusterPreviewAnalysisMesh(T_2=mesh_8, T=gradient_2)

cluster_5 = Cluster_2(num=num_values_to_color_mesh_by_3, L=ticks_6, A=min_bound_2, B=max_bound_2)

gradient_3 = Gradient(
    LowerLimit=min_bound_2,
    UpperLimit=max_bound_2,
    Parameter=cluster_5,
    stops=[0: RGB(234, 38, 0), 0.25: RGB(234, 126, 0), 0.5: RGB(254, 244, 84), 0.75: RGB(173, 203, 249), 1: RGB(75, 107, 169)])

cluster_output_settings_3 = ClusterOutputSettings(
    txt_output_title=item_16,
    txt_description=description_text_2,
    T=gradient_3,
    num_min_bound=min_bound_2,
    num_max_bound=max_bound_2,
    txt_label=label_6,
    _0=ticks_6,
    txt_units=unit_2)
cluster_preview_analysis_mesh_3 = ClusterPreviewAnalysisMesh(T_2=mesh_7, T=gradient_3)

cluster_6 = Cluster_2(num=num_values_to_color_mesh_by_2, L=ticks_7, A=min_bound_3, B=max_bound_3)

gradient_4 = Gradient(LowerLimit=min_bound_3, UpperLimit=max_bound_3, Parameter=cluster_6, stops=[0: RGB(150, 255, 27), 1: RGB(255, 130, 160)])

cluster_output_settings_4 = ClusterOutputSettings(
    txt_output_title=item_15,
    txt_description=description_text_3,
    T=gradient_4,
    num_min_bound=min_bound_3,
    num_max_bound=max_bound_3,
    txt_label=label_7,
    _0=ticks_7,
    txt_units=unit_3)
cluster_preview_analysis_mesh_4 = ClusterPreviewAnalysisMesh(T_2=mesh_6, T=gradient_4)

# ---- group: connect all settings for output
merge_2 = Merge(Data1=cluster_output_settings_2, Data2=cluster_output_settings_3, Data3=cluster_output_settings_4)

# ----
# settings.json
cluster_write_settings_file = ClusterWriteSettingsFile(P=c_create_directory.filePath, W=or, txt_list_of_output_info=merge_2, txt_list_of_input_info=merge)  # -> P_2, T
panel_7 = Panel(cluster_write_settings_file.T)
panel_8 = Panel(cluster_write_settings_file.P_2)

# ----
# 5. export current iteration geometry to xxx_option.json
geo_7 = Geometry(flatten(geo_base_shapes))
mesh_9 = MeshBrep(
    Brep=geo_7,
    Settings={GridMaxCount=0, GridMinCount=16, JaggedSeams=False, MaxEdgeLength=0, MinEdgeLength=0.0001, MinTolerance=0, Refine=True, RefineAngle=0, RelativeTolerance=0.65, SimplePlanes=True, Tolerance=0})

cluster_output_analysis_mesh_5 = ClusterOutputAnalysisMesh_2(txt_file_path=c_create_directory_2.filePath, int_index=data_iteration, txt_output_name="option", m_mesh=mesh_9)

panel_9 = Panel(cluster_output_analysis_mesh_5)

# ---- group: construct title role
txt_output_names_4 = Text(txt_output_names)
txt_output_names_5 = Text(txt_output_names_2)
concat = Concatenate(FragmentA="in_", FragmentB=txt_output_names_4)
concat_2 = Concatenate(FragmentA="out_", FragmentB=txt_output_names_5)
merge_3 = Merge(Data1="iteration", Data2=concat, Data3=concat_2)
txt_headers = Text(merge_3)

# ----
# constructs a xxx_data.csv for every iteration in the .temp folder.
# when button clicked, it will read all these temp xxx_data.csv and compile into one final data.csv
# data.csv
data_iteration_2 = Data(flatten(int_iteration_index))
merge_4 = Merge(Data1=data_iteration_2, Data2=merge_all_inputs, Data3=merge_all_outputs)  # -> flatten(Result)
data_results = Data(merge_4)
join = TextJoin(Text=data_results, Join=",")
warning = Panel(cluster_2.warning_2)
panel_10 = Panel(cluster_2.P)

# ---- group: construct title role (continued)
join_2 = TextJoin(Text=txt_headers, Join=",")

# ---- group: write xxx.csv for each iteration
toggle = BooleanToggle(True)
concat_3 = Concatenate(FragmentA=data_iteration_2, FragmentB="_data.csv")
writetxt = WriteTextFile(Path=c_create_directory_3.filePath, FileName="header.csv", Data=join_2, Write=toggle)
writetxt_2 = WriteTextFile(Path=c_create_directory_3.filePath, FileName="header.csv", Data=join_2, Write=toggle)
writetxt_3 = WriteTextFile(Path=c_create_directory_3.filePath, FileName=concat_3, Data=join, Write=toggle)

# ----
panel_11 = Panel(writetxt_3)
panel_12 = Panel(writetxt)

# ----
# 6. create context.json
# for every new color/material added to the context, create a new mesh
merge_5 = Merge(Data1=mesh_4)
file_name = Panel("context.json")

scene = CompileScene(Objects=merge_5)
scene_2 = CompileScene(Objects=merge_5)

serialize = SerializeObject(Object3d=scene, Minify=False, Run=True)
writetxt_4 = WriteTextFile(Path=filter, FileName=file_name, Data=serialize, Write=or)
panel_13 = Panel(writetxt_4)

# ==== cluster Cluster
int_resolution_of_grid = ClusterInput()
int_explosion_strength = ClusterInput()
int_explosion_location = ClusterInput()
int_resolution_of_grid_2 = Integer(int_resolution_of_grid)
int_explosion_strength_2 = Integer(int_explosion_strength)
int_explosion_location_2 = Integer(int_explosion_location)
division = Division(A="50", B=int_resolution_of_grid_2)
series = Series(Start=0, Step=int_resolution_of_grid_2, Count=division)  # -> graft(Series)
sqgrid = Square(Plane=PlaneXY(0, 0, 0), Size=int_resolution_of_grid_2, ExtentX=division, ExtentY=division)  # -> Cells, Points
int_size_of_grid = Integer(int_resolution_of_grid_2)
Z = UnitZ(Factor=series)
pt = Point(flatten(sqgrid.Points))
move = Move(Geometry=pt, Motion=Z)  # -> Geometry, Transform
pt_array = Point(flatten(move.Geometry))
int_resolution_of_grid_3 = Integer("50")
pt_array_2 = Point(pt_array)
int_size_of_grid_2 = Integer(int_size_of_grid)
lng = ListLength(List=pt_array_2)
division_2 = Division(A=lng, B="5")
int_explosion_location_3 = Integer(int_explosion_location_2)
division_3 = Division(A=int_size_of_grid_2, B="2")
series_2 = Series(Start=0, Step=division_2, Count="5")
item = ListItem(List=series_2, Index=int_explosion_location_3, Wrap=True)
geo_d12 = Geometry(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)
geo_d8 = Geometry(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)
geo_d6 = Geometry(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)
geo_d20 = Geometry(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)
geo_d4 = Geometry(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)
item_2 = ListItem(List=pt_array_2, Index=item, Wrap=True)
scale = Scale(Geometry=geo_d4, Center=Point(0, 0, 0), Factor=division_3)  # -> flatten(Geometry), Transform
scale_2 = Scale(Geometry=geo_d6, Center=Point(0, 0, 0), Factor=division_3)  # -> flatten(Geometry), Transform
scale_3 = Scale(Geometry=geo_d20, Center=Point(0, 0, 0), Factor=division_3)  # -> flatten(Geometry), Transform
scale_4 = Scale(Geometry=geo_d8, Center=Point(0, 0, 0), Factor=division_3)  # -> flatten(Geometry), Transform
scale_5 = Scale(Geometry=geo_d12, Center=Point(0, 0, 0), Factor=division_3)  # -> flatten(Geometry), Transform
int_size_of_grid_3 = Integer(int_size_of_grid_2)
pt_array_3 = Point(pt_array)
int_explosion_strength_3 = Integer(int_explosion_strength_2)
path_mapper = PathMapper(scale.Geometry, source="{A}", target="{0}")
path_mapper_2 = PathMapper(scale_2.Geometry, source="{A}", target="{1}")
path_mapper_3 = PathMapper(scale_4.Geometry, source="{A}", target="{2}")
path_mapper_4 = PathMapper(scale_3.Geometry, source="{A}", target="{4}")
path_mapper_5 = PathMapper(scale_5.Geometry, source="{A}", target="{3}")
pt_explosion_location = Point(item_2)
merge = Merge(Data1=path_mapper, Data2=path_mapper_2, Data3=path_mapper_3, Data4=path_mapper_5, Data5=path_mapper_4)
ln = Line(StartPoint=pt_explosion_location, EndPoint=pt_array_3)
geo_dice = Geometry(merge)
len = Length(Curve=ln)
vec = Vector(ln)
bnd = Bounds(Numbers=len)
dom = ConstructDomain(DomainStart=int_size_of_grid_3, DomainEnd="0")
remap = RemapNumbers(Value=len, Source=bnd, Target=dom)  # -> Mapped, Clipped
multiplication = Multiplication(A=remap.Mapped, B=int_explosion_strength_3)
pt_array_4 = Point(pt_array_3)
amp = Amplitude(Vector=vec, Amplitude=multiplication)
move_2 = Move(Geometry=pt_array_4, Motion=amp)  # -> Geometry, Transform
dist = Distance(PointA=pt_array_4, PointB=move_2.Geometry)
int_resolution_of_grid_4 = Integer(int_resolution_of_grid_3)
num_move_distance = Number(multiplication)
int_size_of_grid_4 = Integer(int_size_of_grid_2)
geo_dice_2 = Geometry(geo_dice)
division_4 = Division(A=dist, B=int_resolution_of_grid_4)
division_5 = Division(A=num_move_distance, B=int_size_of_grid_4)
panel = Panel("""0
1
2
3
4""")
num_distance_color = Number(division_4)
num_distance_of_movement = Number(dist)
round = Round(Number=division_5)  # -> Nearest, Floor, Ceiling
domain = Domain(Domain(0, 0.7))
xy = XYPlane(Origin=Point(0, 0, 0))
avr = Average(Input=num_distance_of_movement)
equals = Equality(FirstNumber=round.Floor, SecondNumber=graft(panel))  # -> Equality, Inequality
remap_2 = RemapNumbers(Value=num_distance_color, Source=domain, Target=Domain(0, 1))  # -> Mapped, Clipped
ln_2 = Line(StartPoint=xy, EndPoint=move_2.Geometry)
geo_dice_3 = Geometry(geo_dice_2)
cull = CullPattern(List=ln_2, CullPattern=equals.Equality)  # -> simplify(List)
panel_2 = Panel("{0:n2}")
cull_2 = CullPattern(List=remap_2.Mapped, CullPattern=equals.Equality)  # -> simplify(flatten(List))
format = Format(Format="{0:n2}", Culture=127, Data0=avr)
lng_2 = ListLength(List=cull)
dup = DuplicateData(Data=geo_dice_3, Number=lng_2, Order=True)
move_3 = Move(Geometry=dup, Motion=cull)  # -> flatten(Geometry), Transform
geo_shape = Geometry(move_3.Geometry)
num_distance_average = Number(format)
num_distance_shape = Number(cull_2)
geo_output = Geometry(geo_shape)
debrep = DeconstructBrep(Brep=geo_output)  # -> graft(Faces), Edges, Vertices
evalsrf = EvaluateSurface(Surface=reparameterize(debrep.Faces), Point="{0.5,0.5,0}")  # -> Point, Normal, UDirection, VDirection, Frame
Z_2 = UnitZ(Factor=1)
pi = Pi(Factor=1)
angle = Angle(VectorA=evalsrf.Normal, VectorB=Z_2)  # -> Angle, Reflex
sort = SortList(Keys=flatten(angle.Angle))  # -> Keys, ValuesA
amp_2 = Amplitude(Vector=evalsrf.Normal, Amplitude=".1")
division_6 = Division(A=angle.Angle, B=pi)
volume = Volume(Geometry=geo_shape)  # -> Volume, Centroid
dcon = DeleteConsecutive(Set=sort.Keys, Wrap=False)  # -> Set, Count
ma = MassAddition(Input=volume.Volume)  # -> Result, PartialResults
scale_6 = Scale(Geometry=geo_shape, Center=volume.Centroid, Factor="1.01")  # -> Geometry, Transform
move_4 = Move(Geometry=debrep.Faces, Motion=amp_2)  # -> Geometry, Transform
lng_3 = ListLength(List=dcon.Set)
geo_faces = Geometry(move_4.Geometry)
geometry = Geometry()  # "------------------"
num_distance_average_2 = Number(num_distance_average)
num_angle_face = Number(division_6)
geo_shapes_to_color = Geometry(scale_6.Geometry)
int_volume_total = Integer(ma.Result)
int_volume_shape = Integer(volume.Volume)
num_distance_shape_2 = Number(num_distance_shape)
geometry_2 = Geometry()  # "------------------"
geometry_3 = Geometry()  # "------------------"
geo_shapes = Geometry(geo_shape)
num_angle_number_of_unique = Number(lng_3)
geometry_4 = ClusterOutput(geometry)  # "------------------"
geo_shapes_2 = ClusterOutput(geo_shapes)
int_volume_total_2 = ClusterOutput(int_volume_total)
int_volume_shape_2 = ClusterOutput(int_volume_shape)
geometry_5 = ClusterOutput(geometry_2)  # "------------------"
geometry_6 = ClusterOutput(geometry_3)  # "------------------"
num_distance_average_3 = ClusterOutput(num_distance_average_2)
num_distance_shape_3 = ClusterOutput(num_distance_shape_2)
geo_faces_2 = ClusterOutput(geo_faces)
geo_shapes_to_color_2 = ClusterOutput(geo_shapes_to_color)
num_angle_face_2 = ClusterOutput(num_angle_face)
num_angle_number_of_unique_2 = ClusterOutput(num_angle_number_of_unique)

# ==== cluster ClusterOutputAnalysisMesh
V = ClusterInput()
m_exploded_analysis_mesh = ClusterInput()
txt_output_name = ClusterInput()
txt_file_path = ClusterInput()
int_index = ClusterInput()
standardmat = MeshStandardMaterial(Color=RGB(255, 255, 255), Opacity=1, Roughness=1, Metalness=0.5, Emissive=RGB(0, 0, 0), EmissiveIntensity=1)
tri = Triangulate(MExplodedAnalysisMesh=m_exploded_analysis_mesh)  # -> Mesh, Count
userdata = UserData(Keys="customAttribute", Values=graft(V))
int_index_2 = Data(int_index)
txt_output_name_2 = Text(txt_output_name)
mesh = Mesh(Mesh=tri.Mesh, Material=standardmat, DecimalAccuracy=3, UserData=flatten(userdata))
concat = Concatenate(FragmentA=int_index_2, FragmentC="_", FragmentB=txt_output_name_2, FragmentD=".json")
scene = CompileScene(Objects=mesh)
txt_file_path_2 = Text(txt_file_path)
serialize = SerializeObject(Object3d=scene, Minify=False, Run=True)
writetxt = WriteTextFile(Path=txt_file_path_2, FileName=concat, Data=serialize, Write=Toggle(True))
P = ClusterOutput(writetxt)

# ==== cluster ClusterOutputSettings
T = ClusterInput()
branch = TreeBranch(Tree=T, Path="{0;1}", MaintainPaths=True)
_0 = ClusterInput()
c_script = CSharpScript(color=branch)  # -> out, A; inputs color: Color
# ---------- c_script: C# usings ----------
using System.Drawing;
# ---------- c_script: C# ----------
    A = System.Drawing.ColorTranslator.ToHtml(color);
# ---------- end c_script ----------
format = Format(Format="\"{0}\"", Culture=127, Data0=_0)
format_2 = Format(Format="\"{0}\"", Culture=127, Data0=c_script.A)
join = TextJoin(TextList=format, Join=",")
panel = Panel("""    "{0}": {{
      "description":"{1}",
      "colorRamp":[{2}],
      "minBound": {3},
      "maxBound": {4},
      "label": "{5}",
      "model": "{6}",
      "ticks": [{7}],
      "units": "{8}",
      "materialType": "{9}",
      "analysis_mesh": {10}
    }}""")
join_2 = TextJoin(Text=format_2, Join=",")
txt_description = ClusterInput()
num_min_bound = ClusterInput()
num_max_bound = ClusterInput()
txt_units = ClusterInput()
txt_output_title = ClusterInput()
txt_label = ClusterInput()
num_min_bound_2 = Number(num_min_bound)
num_max_bound_2 = Number(num_max_bound)
txt_ticks = Text(join)
txt_units_2 = Text(txt_units)
txt_output_title_2 = Text(txt_output_title)
txt_description_2 = Text(txt_description)
txt_color_ramp = Text(join_2)
txt_label_2 = Text(txt_label)
format_3 = Format(
    Format=panel,
    Culture=127,
    Data0=txt_output_title_2,
    Data1=txt_description_2,
    Data2=txt_color_ramp,
    Data3=num_min_bound_2,
    Data4=num_max_bound_2,
    Data5=txt_label_2,
    Data6="base",
    Data7=txt_ticks,
    Data8=txt_units_2,
    Data9="MeshStandardMaterial",
    Data10="true")
T_2 = ClusterOutput(format_3)

# ==== cluster ClusterInputSettings
txt_input_title = ClusterInput()
_0 = ClusterInput()
txt_label = ClusterInput()
format = Format(Format="\"{0}\"", Culture=127, Data0=_0)
join = TextJoin(TextList=format, Join=",")
panel = Panel("""    "in_{0}": {{
      "labels": [{2}],
      "label": "{1}"
    }}""")
txt_input_title_2 = Text(txt_input_title)
txt_ticks = Text(join)
txt_label_2 = Text(txt_label)
format_2 = Format(Format=panel, Culture=127, Data0=txt_input_title_2, Data1=txt_label_2, Data2=txt_ticks)
T = ClusterOutput(format_2)

# ==== cluster ClusterWriteSettingsFile
txt_list_of_input_info = ClusterInput()
txt_list_of_output_info = ClusterInput()
txt_list_of_input_info_2 = Text(flatten(txt_list_of_input_info))
txt_list_of_output_info_2 = Text(flatten(txt_list_of_output_info))
join = TextJoin(Text=txt_list_of_input_info_2, Join=",")
join_2 = TextJoin(Text=txt_list_of_output_info_2, Join=",")
panel = Panel("""{{
  "metricInfo": {{
{0}
  }},
  "inputInfo": {{
{1}
  }}
}}""")
format = Format(Format=panel, Culture=1033, Data0=join_2, Data1=join)
T = ClusterOutput(format)
P = ClusterInput()
W = ClusterInput()
writetxt = WriteTextFile(Path=P, FileName="settings.json", Data=format, Write=W)
P_2 = ClusterOutput(writetxt)

# ==== cluster Cluster_2
L = ClusterInput()
A = ClusterInput()
B = ClusterInput()
lng = ListLength(List=L)
dom = ConstructDomain(DomainStart=A, DomainEnd=B)
larger = LargerThan(FirstNumber=lng, SecondNumber="10")  # -> LargerThan, OrEqualTo
filter = StreamFilter(Gate=larger.LargerThan, Stream0="10", Stream1=lng)
div = DivideDomain(Domain=dom, Count=filter)
num = ClusterInput()
dedomain = DeconstructDomain(Domain=div)  # -> Start, End
cset = CreateSet(List=[dedomain.Start, dedomain.End])  # -> Set, Map
num_2 = Number(num)
entwine = Entwine(Branch00=num_2, Branch01=cset.Set, FlattenInputs=True)
R = ClusterOutput(entwine)

# ==== cluster ClusterPreviewAnalysisMesh
T = ClusterInput()
T_2 = ClusterInput()

# ---- group: preview analysis mesh
branch = TreeBranch(Tree=T, Path="{0;0}", MaintainPaths=True)
graft = GraftTree(Tree=T_2, IncludeEmptyLists=True, IncludeNullItems=True)
graft_2 = GraftTree(Tree=branch, IncludeEmptyLists=True, IncludeNullItems=True)
mcol = MeshColours(Mesh=graft(graft), Colours=graft(graft_2))  # -> flatten(Mesh)

# ----
M = ClusterOutput(mcol)

# ==== cluster ClusterOutputAnalysisMesh_2
m_mesh = ClusterInput()
txt_output_name = ClusterInput()
txt_file_path = ClusterInput()
int_index = ClusterInput()
tri = Triangulate(MMesh=m_mesh)  # -> Mesh, Count
mjoin = MeshJoin(Meshes=tri.Mesh)
standardmat = MeshStandardMaterial(Color=RGB(255, 255, 255), Opacity=1, Roughness=1, Metalness=0.5, Emissive=RGB(0, 0, 0), EmissiveIntensity=1)
int_index_2 = Data(int_index)
txt_output_name_2 = Text(txt_output_name)
mesh = Mesh(Mesh=mjoin, Material=standardmat, DecimalAccuracy=3)
concat = Concatenate(FragmentA=int_index_2, FragmentC="_", FragmentB=txt_output_name_2, FragmentD=".json")
scene = CompileScene(Objects=mesh)
txt_file_path_2 = Text(txt_file_path)
serialize = SerializeObject(Object3d=scene, Minify=False, Run=True)
writetxt = WriteTextFile(Path=txt_file_path_2, FileName=concat, Data=serialize, Write=Toggle(True))
P = ClusterOutput(writetxt)

# ==== cluster Cluster_4
bool = ClusterInput()
directory = ClusterInput()
bool_2 = Boolean(bool)
c_script = CSharpScript(directory=directory, compile="true")  # -> out, A, B; inputs directory: String, compile: Boolean
# ---------- c_script: C# usings ----------
using System.IO;
# ---------- c_script: C# ----------
    if(!compile) return;

    string[] paths = Directory.GetFiles(directory);
    List<String> csvs = new List<String>();

    csvs.Add(File.ReadAllText(directory + "\\header.csv"));
    
    int headerInt = 0;
    int i = 0 ;
    foreach (string p in paths){
      
      if (p == directory + "\\header.csv"){
        headerInt = i; 
        continue;
      }
      csvs.Add(File.ReadAllText(p));
      i++;
    }
    
    // remove header from path
    List<string> pathsList = new List<string>(paths);
    pathsList.RemoveAt(headerInt);
    // add header path to front
    pathsList.Insert(0, directory + "\\header.csv");
    A = csvs;
    B = pathsList;
# ---------- end c_script ----------

# ---- group: remove empty strings
len = TextLength(Text=c_script.A)
larger = LargerThan(FirstNumber=len, SecondNumber=1)  # -> LargerThan, OrEqualTo
cull = CullPattern(List=c_script.A, CullPattern=larger.LargerThan)

# ----
panel = Panel("random,invalid,text")
cull_2 = CullPattern(List=c_script.B, CullPattern=larger.LargerThan)
txt = Text(flatten(cull))
split = TextSplit(Text=txt, Separators=",")
item = ListItem(List=split, Index=0, Wrap=True)  # -> flatten(Item)
num = Number(item)
null = NullItem(Item=num)  # -> NullFlags, InvalidFlags, Description
dispatch = Dispatch(List=cull_2, DispatchPattern=null.NullFlags)  # -> ListA, ListB

# ---- group: sort iterations
dispatch_2 = Dispatch(List=txt, DispatchPattern=null.NullFlags)  # -> ListA, ListB
dispatch_3 = Dispatch(List=num, DispatchPattern=null.NullFlags)  # -> ListA, ListB
sort = SortList(Keys=dispatch_3.ListB, ValuesA=dispatch_2.ListB, ValuesB=dispatch.ListB)  # -> Keys, ValuesA, ValuesB

# ---- group: if starting with anything thats not number, only allow "iteration" to pass through
dispatch_4 = Dispatch(List=item, DispatchPattern=null.NullFlags)  # -> ListA, ListB
tdist = TextDistance(TextA=dispatch_4.ListA, TextB="iteration", Case=True)
equals = Equality(FirstNumber=tdist, SecondNumber=0)  # -> Equality, Inequality
cull_3 = CullPattern(List=dispatch_2.ListA, CullPattern=equals.Equality)

# ---- group: ensure all numbers
split_2 = TextSplit(Text=sort.ValuesA, Separators=",")
num_2 = Number(split_2)
null_2 = NullItem(Item=num_2)  # -> NullFlags, InvalidFlags, Description
ma = MassAddition(Input=null_2.NullFlags)  # -> flatten(Result), PartialResults
equals_2 = Equality(FirstNumber=ma.Result, SecondNumber=0)  # -> Equality, Inequality
cull_4 = CullPattern(List=sort.ValuesA, CullPattern=equals_2.Equality)

# ----
not = GateNot(A=larger.LargerThan)
cull_5 = CullPattern(List=c_script.B, CullPattern=not)
lng = ListLength(List=flatten(cull_5))
panel_2 = Panel("data in following filess contains none numbers. They will be excluded from the final data.csv. Please check to make sure theres no scientific notations or other texts and all data are numbers. ")
larger_2 = LargerThan(FirstNumber=lng, SecondNumber=0)  # -> LargerThan, OrEqualTo
cull_6 = CullPattern(List=sort.ValuesB, CullPattern=equals_2.Inequality)
ma_2 = MassAddition(Input=equals_2.Inequality)  # -> Result, PartialResults
cull_7 = CullPattern(List=sort.ValuesB, CullPattern=equals_2.Inequality)
filter = StreamFilter(Gate=ma_2.Result, Stream1=[panel_2, cull_6])  # -> flatten(Stream)
filter_2 = StreamFilter(Gate=larger_2.LargerThan, Stream1=["following files are empty:", cull_5])  # -> flatten(Stream)
merge = Merge(Data1=flatten(cull_3), Data2=flatten(cull_4))  # -> flatten(Result)
entwine = Entwine(Branch00=filter, Branch01=filter_2, FlattenInputs=True)
p_file_path = ClusterInput()
warning = Text(entwine)
panel_3 = Panel(entwine)
cluster = Cluster_3(P=p_file_path, T=merge, W=bool_2)
warning_2 = ClusterOutput(warning)
P = ClusterOutput(cluster)

# ==== cluster Cluster_3
T = ClusterInput()
join = TextJoin(Text=T)
P = ClusterInput()
W = ClusterInput()
writetxt = WriteTextFile(Path=P, FileName="data.csv", Data=join, Write=W)
P_2 = ClusterOutput(writetxt)
